# Grasshopper definition Andrew Examples.gh (Grasshopper 0.9.76)
# plug-ins: MarchingCubes

geo = Geometry([<brep referenced from the Rhino model> x57])
geo_2 = Geometry(<brep referenced from the Rhino model>)
sint = SolidIntersection(BrepsA=geo, BrepsB=geo_2)
edges = BrepEdges(Brep=sint)  # -> Naked, Interior, NonManifold
pipe = Pipe(Curve=edges.Interior, Radius=0.05, Caps=2)
group_charge = CurveGroupCharge(Curves=edges.Interior, Radius=Slider(0.1, range=0..1), ChargeStrengths=Slider(1, range=0..1))
cocoon = Cocoon(
    Charges=group_charge,
    Iso=Slider(0.184, range=0..1),
    CellSize=Slider(0.059, range=0..1),
    Execute=Toggle(True),
    Simple=False)  # -> Mesh, RefinementData
refine = Refine(
    RefinementData=cocoon.RefinementData,
    Samples=Slider(2, range=0..10),
    SampleSize=Slider(0.1, range=0..1),
    SampleTolerance=Slider(0.2, range=0..1),
    LaplacianSmoothing=Slider(1, range=0..10),
    ValencePasses=Slider(1, range=0..10),
    SubD=Slider(0, range=0..10),
    Execute=Toggle(True))
