# Grasshopper definition Coding for Theatre.gh (Grasshopper 0.9.76)
# plug-ins: Exoskeleton, Weaverbird

# ---- group: DJ Booth
number_slider = Slider(1, range=0..1)
number_slider_2 = Slider(2, range=0..10)
dj_booth = Curve(<curve referenced from the Rhino model>)
dj_booth_2 = Curve(<curve referenced from the Rhino model>)
Z = UnitZ(Factor=number_slider_2)
srf = Surface(dj_booth_2)
offset = Offset(Curve=dj_booth, Distance=expr("-x", Slider(0.06, range=0..0.2)), Plane=PlaneXY(0, 0, 0), Corners=number_slider)  # -> flatten(Curve)
move = Move(Geometry=srf, Motion=Z)  # -> Geometry, Transform
Z_2 = UnitZ(Factor=number_slider_2)
loft = Loft(
    Curves=[dj_booth, offset],
    Options={Adjust=False, Closed=False, LoftEnds=0, LoftSimp=0, LoftType=0, Rebuild=10, Refit=0.01})
loft_2 = Loft(
    Curves=[srf, move.Geometry],
    Options={Adjust=False, Closed=False, LoftEnds=0, LoftSimp=0, LoftType=0, Rebuild=10, Refit=0.01})
move_2 = Move(Geometry=loft, Motion=Z_2)  # -> Geometry, Transform
Z_3 = UnitZ(Factor=Slider(1, range=0..1))
move_3 = Move(Geometry=move_2.Geometry, Motion=Z_3)  # -> Geometry, Transform
loft_3 = Loft(
    Curves=[move_2.Geometry, move_3.Geometry],
    Options={Adjust=False, Closed=False, LoftEnds=0, LoftSimp=0, LoftType=0, Rebuild=10, Refit=0.01})

# ----
# boundries of the Voronoi
# 
# Make a web, or create balls of voronoi
# 
# Roof?
# 
# How to make the floor of the asscention room hit ground level on the back level
number_slider_3 = Slider(6, range=0..10)
crv = Curve(<curve referenced from the Rhino model>)
crv_2 = Curve(<curve referenced from the Rhino model>)
rooms = Curve([<curve referenced from the Rhino model> x8])
bathrooms = Curve([<curve referenced from the Rhino model> x6])
crv_3 = Curve(<curve referenced from the Rhino model>)
srf_2 = Surface(crv_2)
offset_2 = Offset(Curve=crv, Distance=expr("x", Slider(0.02, range=0..0.1)), Plane=PlaneXY(0, 0, 0), Corners=number_slider)  # -> flatten(Curve)
offset_3 = Offset(Curve=crv, Distance=expr("x", Slider(0.06, range=0..0.1)), Plane=PlaneXY(0, 0, 0), Corners=number_slider)  # -> flatten(Curve)
offset_4 = Offset(Curve=crv, Distance=expr("x", Slider(0.08, range=0..0.1)), Plane=PlaneXY(0, 0, 0), Corners=number_slider)  # -> flatten(Curve)
srf_3 = Surface(simplify(graft(bathrooms)))
srf_4 = Surface(simplify(graft(rooms)))
Z_4 = UnitZ(Factor=number_slider_3)
srf_5 = Surface(crv_3)
Z_5 = UnitZ(Factor=Slider(3, range=0..5))
Z_6 = UnitZ(Factor=Slider(6, range=0..10))
popgeo = PopulateGeometry(Geometry=srf_2, Count=Slider(18, range=0..100), Seed=Slider(4, range=0..10))
move_4 = Move(Geometry=srf_5, Motion=Z_4)  # -> Geometry, Transform
move_5 = Move(Geometry=srf_3, Motion=Z_5)  # -> simplify(graft(Geometry)), Transform
move_6 = Move(Geometry=srf_4, Motion=Z_6)  # -> simplify(graft(Geometry)), Transform
loft_4 = Loft(Curves=[crv, offset_2], Options={Adjust=False, Closed=False, LoftEnds=0, LoftSimp=0, LoftType=0, Rebuild=10, Refit=0.01})
voronoi = Voronoi(Points=popgeo, BruteForceOverride=False)
loft_5 = Loft(
    Curves=[offset_3, offset_4],
    Options={Adjust=False, Closed=False, LoftEnds=0, LoftSimp=0, LoftType=0, Rebuild=10, Refit=0.01})
loft_6 = Loft(
    Curves=[srf_5, move_4.Geometry],
    Options={Adjust=False, Closed=False, LoftEnds=0, LoftSimp=0, LoftType=0, Rebuild=10, Refit=0.01})
panel = Panel(".http://www.grasshopper3d.com/forum/topics/inside-voronoi-cells-selection")
Z_7 = UnitZ(Factor=Slider(6, range=0..10))
rint = RegionIntersection(CurvesA=graft(voronoi), CurvesB=crv_2)
move_7 = Move(Geometry=loft_4, Motion=Z_7)  # -> Geometry, Transform
move_8 = Move(Geometry=loft_5, Motion=Z_7)  # -> Geometry, Transform
loft_7 = Loft(
    Curves=[srf_3, move_5.Geometry],
    Options={Adjust=False, Closed=False, LoftEnds=0, LoftSimp=0, LoftType=0, Rebuild=10, Refit=0.01})
loft_8 = Loft(
    Curves=[srf_4, move_6.Geometry],
    Options={Adjust=False, Closed=False, LoftEnds=0, LoftSimp=0, LoftType=0, Rebuild=10, Refit=0.01})
cap = CapHoles(Brep=loft_6)
cap_2 = CapHoles(Brep=loft_2)
cap_3 = CapHoles(Brep=loft_7)
cap_4 = CapHoles(Brep=loft_8)
brep = Brep(cap)
pt = Point(<point referenced from the Rhino model>)
loft_9 = Loft(
    Curves=[move_7.Geometry, loft_4],
    Options={Adjust=False, Closed=False, LoftEnds=0, LoftSimp=0, LoftType=0, Rebuild=10, Refit=0.01})
loft_10 = Loft(
    Curves=[move_8.Geometry, loft_5],
    Options={Adjust=False, Closed=False, LoftEnds=0, LoftSimp=0, LoftType=0, Rebuild=10, Refit=0.01})
pt_2 = Point(<point referenced from the Rhino model>)
area = Area(Geometry=[srf_3, srf_4])  # -> simplify(flatten(Area)), Centroid
brep_2 = Brep(cap_3)
brep_3 = Brep(cap_4)
popgeo_2 = PopulateGeometry(Geometry=brep, Count=Slider(70, range=0..100), Seed=1)
prox_max = Slider(10, range=0..10)
prox_min = Slider(0, range=0..10)
voronoi³ = Voronoi3D(Points=popgeo_2, Box=brep)  # -> Cells, Boundary
ma = MassAddition(Input=area.Area)  # -> Result, PartialResults
crv_4 = Curve([<curve referenced from the Rhino model> x2])
volume = Volume(Geometry=voronoi³.Cells)  # -> Volume, Centroid
explode = Explode(Curve=rint, Recursive=True)  # -> reparameterize(Segments), Vertices
panel_2 = Panel(ma.Result)
srf_6 = Surface(crv_4)
dom = ConstructDomain(DomainStart=prox_max, DomainEnd=prox_min)
dist = Distance(PointA=pt_2, PointB=volume.Centroid)

prox_min_2 = Slider(0, range=0..10)
prox_max_2 = Slider(5, range=0..10)
dom_2 = ConstructDomain(DomainStart=prox_min_2, DomainEnd=prox_max_2)
remap = RemapNumbers(Value=dist, Source=dom_2, Target=Domain(0, 1))  # -> Mapped, Clipped
max_height = Slider(0.9, range=0..1.3)
min_height = Slider(0.15, range=0..1)
graph = GraphMapper(
    remap.Mapped,
    x0=0,
    x1=1,
    y0=0,
    y1=1,
    container_name="Sine",
    Equation_px=[0.2018020153, 1],
    Equation_py=[0.01954871416, 1])
dom_3 = ConstructDomain(DomainStart=max_height, DomainEnd=min_height)
remap_2 = RemapNumbers(Value=graph, Source=Domain(0, 1), Target=dom_3)  # -> Mapped, Clipped

eval = EvaluateCurve(Curve=explode.Segments, Parameter=0.5)  # -> Point, Tangent, Angle
join = BrepJoin(Breps=srf_6)  # -> Breps, Closed
remap_3 = RemapNumbers(Value=dist, Source=dom, Target=Domain(0, 1))  # -> Mapped, Clipped
brep_cp = BrepClosestPoint(Point=eval.Point, Brep=join.Breps)  # -> Point, Distance
max_height_2 = Slider(0.8, range=0..5)
min_height_2 = Slider(0, range=0..5)
graph_2 = GraphMapper(remap_3.Mapped, x0=0, x1=1, y0=0, y1=1, container_name="Bezier", cpx=[0, 0.25, 0.75, 1], cpy=[0, 0.25, 0.75, 1])
smaller = SmallerThan(FirstNumber=brep_cp.Distance, SecondNumber=0.1)  # -> SmallerThan, OrEqualTo
dom_4 = ConstructDomain(DomainStart=max_height_2, DomainEnd=min_height_2)
ma_2 = MassAddition(Input=smaller.SmallerThan)  # -> Result, PartialResults
dispatch = Dispatch(List=rint, DispatchPattern=ma_2.Result)  # -> ListA, ListB
area_2 = Area(Geometry=dispatch.ListB)  # -> Area, Centroid
dist_2 = Distance(PointA=pt, PointB=area_2.Centroid)

prox_min_3 = Slider(0, range=0..10)
prox_max_3 = Slider(5, range=0..10)
dom_5 = ConstructDomain(DomainStart=prox_min_3, DomainEnd=prox_max_3)
remap_4 = RemapNumbers(Value=dist_2, Source=dom_5, Target=Domain(0, 1))  # -> Mapped, Clipped
max_height_3 = Slider(2, range=0..5)
min_height_3 = Slider(0, range=0..5)
graph_3 = GraphMapper(
    remap_4.Mapped,
    x0=0,
    x1=1,
    y0=0,
    y1=1,
    A=0.7419662965,
    B=0.1774434447,
    container_name="Linear",
    Graph_x0=0,
    Graph_x1=0.7782610655,
    Graph_y0=0.1774434447,
    Graph_y1=0.7548869252)
dom_6 = ConstructDomain(DomainStart=max_height_3, DomainEnd=min_height_3)
remap_5 = RemapNumbers(Value=graph_3, Source=Domain(0, 1), Target=dom_6)  # -> Mapped, Clipped
Z_8 = UnitZ(Factor=remap_5.Mapped)
move_9 = Move(Geometry=dispatch.ListB, Motion=Z_8)  # -> Geometry, Transform

remap_6 = RemapNumbers(Value=graph_2, Source=Domain(0, 1), Target=dom_4)  # -> Mapped, Clipped
scale = Scale(Geometry=voronoi³.Cells, Center=volume.Centroid, Factor=remap_6.Mapped)  # -> Geometry, Transform
scale_2 = Scale(Geometry=voronoi³.Cells, Center=volume.Centroid, Factor=remap_2.Clipped)  # -> Geometry, Transform
clean = CleanTree(RemoveNulls=True, RemoveInvalid=True, RemoveEmpty=False, Tree=scale_2.Geometry)
volume_2 = Volume(Geometry=scale_2.Geometry)  # -> Volume, Centroid
mesh = Mesh(scale_2.Geometry)
loft_11 = Loft(
    Curves=[dispatch.ListB, move_9.Geometry],
    Options={Adjust=False, Closed=False, LoftEnds=0, LoftSimp=0, LoftType=0, Rebuild=10, Refit=0.01})
mesh_2 = Mesh(scale.Geometry)
prox = Proximity3D(Points=volume_2.Centroid, Group=5)  # -> Links, Topology
Z_9 = UnitZ(Factor=Slider(6, range=0..10))
crv_5 = Curve(<curve referenced from the Rhino model>)
demesh = DeconstructMesh(Mesh=mesh)  # -> Vertices, Faces, Colours, Normals; disabled
debrep = DeconstructBrep(Brep=clean)  # -> Faces, simplify(Edges), Vertices
cap_5 = CapHoles(Brep=loft_11)
bbox = BoundingBox(Content=scale_2.Geometry, Plane=PlaneXY(0, 0, 0), UnionBox=True)  # -> Box, Box_2
move_10 = Move(Geometry=crv_5, Motion=Z_9)  # -> Geometry, Transform
offset_5 = Offset(Curve=move_10.Geometry, Distance=expr("-x", Slider(0.13, range=0..1)), Plane=PlaneXY(0, 0, 0), Corners=1)
mesh_3 = Mesh(cap_5)
branch = TreeBranch(Tree=debrep.Edges, Path="{2}", MaintainPaths=True)
debox = DeconstructBox(Box=bbox.Box)  # -> Plane, X, Y, Z
srf_7 = Surface(move_10.Geometry)
line = Line(debrep.Edges)
wbblur = WeaverbirdsBlurMesh(MeshCurves=mesh_3, Level=1, Thin=1)
popgeo_3 = PopulateGeometry(Geometry=srf_7, Count=Slider(59, range=0..100), Seed=Slider(4, range=0..10))
dedomain = DeconstructDomain(Domain=debox.Z)  # -> Start, End
number_slider_4 = Slider(0.08, range=0..0.1)  # disabled
number_slider_5 = Slider(0.04, range=0..0.1)  # disabled
number_slider_6 = Slider(0.3, range=0..1)  # disabled
voronoi_2 = Voronoi(Points=popgeo_3, BruteForceOverride=False)
pt_3 = ConstructPoint(XCoordinate=0, YCoordinate=0, ZCoordinate=dedomain.End)
srf_8 = Surface(srf_7)
rint_2 = RegionIntersection(CurvesA=graft(voronoi_2), CurvesB=move_10.Geometry)
xy = XYPlane(Origin=pt_3)
popgeo_4 = PopulateGeometry(Geometry=srf_8, Count=Slider(59, range=0..100), Seed=Slider(4, range=0..10))
exo = Exoskeleton(
    Lines=flatten(line),
    Sides=6,
    Thickness=number_slider_5,
    NodeSize=number_slider_4,
    Knuckle=number_slider_6,
    Spacing=3,
    Open=False)  # disabled
project = Project(Geometry=volume_2.Centroid, Plane=xy)  # -> Geometry, Transform
area_3 = Area(Geometry=rint_2)  # -> Area, Centroid
voronoi_3 = Voronoi(Points=popgeo_4, BruteForceOverride=False)
pt_4 = Point(<point referenced from the Rhino model>)
prox_max_4 = Slider(4.3, range=0..10)
prox_min_4 = Slider(0, range=0..10)
panel_3 = Panel("http://www.grasshopper3d.com/profiles/blogs/introducing-exoskeleton-a-wireframe-thickening-tool#comments")
rint_3 = RegionIntersection(CurvesA=graft(voronoi_3), CurvesB=offset_5)
ln = Line(StartPoint=volume_2.Centroid, EndPoint=project.Geometry)
dist_3 = Distance(PointA=pt_4, PointB=area_3.Centroid)
area_4 = Area(Geometry=rint_3)  # -> Area, Centroid
pt_5 = Point(<point referenced from the Rhino model>)
prox_min_5 = Slider(0, range=0..10)
prox_max_5 = Slider(4.3, range=0..10)
dom_7 = ConstructDomain(DomainStart=prox_min_4, DomainEnd=prox_max_4)
exo_2 = Exoskeleton(
    Lines=ln,
    Sides=6,
    Thickness=Slider(0.05, range=0..1),
    NodeSize=Slider(0.1, range=0..0.1),
    Knuckle=Slider(0.48, range=0..1),
    Spacing=Slider(7, range=0..10),
    Open=False)
dist_4 = Distance(PointA=pt_5, PointB=area_4.Centroid)
remap_7 = RemapNumbers(Value=dist_3, Source=dom_7, Target=Domain(0, 1))  # -> Mapped, Clipped
max_height_4 = Slider(4, range=0..5)
min_height_4 = Slider(0, range=0..5)
graph_4 = GraphMapper(
    remap_7.Mapped,
    x0=0,
    x1=1,
    y0=0,
    y1=1,
    A=0.7419662965,
    B=0.1774434447,
    container_name="Linear",
    Graph_x0=0,
    Graph_x1=0.7782610655,
    Graph_y0=0.1774434447,
    Graph_y1=0.7548869252)
dom_8 = ConstructDomain(DomainStart=prox_min_5, DomainEnd=prox_max_5)
remap_8 = RemapNumbers(Value=dist_4, Source=dom_8, Target=Domain(0, 1))  # -> Mapped, Clipped
max_height_5 = Slider(4, range=0..5)
min_height_5 = Slider(0, range=0..5)
dom_9 = ConstructDomain(DomainStart=max_height_4, DomainEnd=min_height_4)
graph_5 = GraphMapper(
    remap_8.Mapped,
    x0=0,
    x1=1,
    y0=0,
    y1=1,
    A=0.7419662965,
    B=0.1774434447,
    container_name="Linear",
    Graph_x0=0,
    Graph_x1=0.7782610655,
    Graph_y0=0.1774434447,
    Graph_y1=0.7548869252)
remap_9 = RemapNumbers(Value=graph_4, Source=Domain(0, 1), Target=dom_9)  # -> Mapped, Clipped
Z_10 = UnitZ(Factor=remap_9.Mapped)
dom_10 = ConstructDomain(DomainStart=max_height_5, DomainEnd=min_height_5)
Z_11 = UnitZ(Factor=Slider(0.3, range=0..1))
move_11 = Move(Geometry=rint_2, Motion=Z_10)  # -> Geometry, Transform
remap_10 = RemapNumbers(Value=graph_5, Source=Domain(0, 1), Target=dom_10)  # -> Mapped, Clipped
move_12 = Move(Geometry=rint_2, Motion=Z_11)  # -> Geometry, Transform
Z_12 = UnitZ(Factor=remap_10.Mapped)
Z_13 = UnitZ(Factor=Slider(0.3, range=0..1))
loft_12 = Loft(
    Curves=[move_11.Geometry, move_12.Geometry],
    Options={Adjust=False, Closed=False, LoftEnds=0, LoftSimp=0, LoftType=0, Rebuild=10, Refit=0.01})
move_13 = Move(Geometry=rint_3, Motion=Z_12)  # -> Geometry, Transform
cap_6 = CapHoles(Brep=loft_12)
move_14 = Move(Geometry=rint_3, Motion=Z_13)  # -> Geometry, Transform
volume_3 = Volume(Geometry=cap_6)  # -> Volume, Centroid
loft_13 = Loft(
    Curves=[move_13.Geometry, move_14.Geometry],
    Options={Adjust=False, Closed=False, LoftEnds=0, LoftSimp=0, LoftType=0, Rebuild=10, Refit=0.01})
scale_3 = Scale(Geometry=cap_6, Center=volume_3.Centroid, Factor=Slider(0.9, range=0..1))  # -> Geometry, Transform
cap_7 = CapHoles(Brep=loft_13)
volume_4 = Volume(Geometry=cap_7)  # -> Volume, Centroid
mesh_4 = Mesh(scale_3.Geometry)
scale_4 = Scale(Geometry=cap_7, Center=volume_4.Centroid, Factor=Slider(0.9, range=0..1))  # -> Geometry, Transform
Z_14 = UnitZ(Factor=Slider(0.1, range=0..1))
wbblur_2 = WeaverbirdsBlurMesh(MeshCurves=mesh_4, Level=1, Thin=1)
extr = Extrude(Base=srf_7, Direction=expr("-x", Z_14))
mesh_5 = Mesh(scale_4.Geometry)
mesh_6 = Mesh(wbblur_2)
Z_15 = UnitZ(Factor=Slider(0.1, range=0..1))
wbblur_3 = WeaverbirdsBlurMesh(MeshCurves=mesh_5, Level=Slider(2, range=0..10), Thin=1)
mesh_7 = Mesh(extr)
mdif = MeshDifference(MeshesA=mesh_7, MeshesB=mesh_6)
extr_2 = Extrude(Base=srf_8, Direction=expr("-x", Z_15))
mesh_8 = Mesh(wbblur_3)
mesh_9 = Mesh(extr_2)
mdif_2 = MeshDifference(MeshesA=mesh_9, MeshesB=mesh_8)
